# Dynamo graph section form scope box.dyn "create section for scope box" (Dynamo 3.0.3.7597)
# packages: archi-lab.net 2025.300.1225

YZ = Plane.YZ()
XZ = Plane.XZ()
normal = Plane.Normal(plane=XZ)
reverse = Vector.Reverse(vector=normal)
byOriginNormal = Plane.ByOriginNormal(normal=reverse)
list_create = List.Create(item0=YZ, item1=byOriginNormal)
toCoordinateSystem = Plane.ToCoordinateSystem(plane=list_create)
categories = Categories("OST_VolumeOfInterest")
all_elements_of_category = ElementsOfCategory(Category=categories)
boundingBox = Element.BoundingBox(element=all_elements_of_category)
code_block = CodeBlock(a=boundingBox) { [Autodesk.BoundingBox.MinPoint(a)]; [Autodesk.BoundingBox.MaxPoint(a)]; }
byCoordinateSystemMinPointMaxPoint = SectionView.ByCoordinateSystemMinPointMaxPoint(cs=toCoordinateSystem, minPoint=code_block.out0, maxPoint=code_block.out1, lacing=Longest)
code_block_2 = CodeBlock { "Scope Box"; }
code_block_3 = CodeBlock(a=all_elements_of_category) { [a]; }
setParameterByName = Element.SetParameterByName(element=byCoordinateSystemMinPointMaxPoint, parameterName=code_block_2, value=code_block_3, lacing=Longest)
select_model_element = DSModelElementSelection()  # 1 picked in the model
location = archilab.Revit.Elements.Elements.Location(element=select_model_element)
code_block_4 = CodeBlock { "rr"; false; }
byEyePointAndTarget = PerspectiveView.ByEyePointAndTarget(target=location.Point, element=boundingBox, name=code_block_4.out0, isolateElement=code_block_4.out1)  # unwired: eyePoint
select_point_on_face = DSPointOnElementSelection()  # 1 picked in the model
code_block_5 = CodeBlock(a=select_point_on_face) { a; b =a.Z+c; }  # unwired: c
byCoordinates = Point.ByCoordinates()
code_block_6 = CodeBlock { 150; 50; }
convert_by_units = DynamoUnitConvert(code_block_6.out1, MeasurementType="autodesk.unit.quantity:length-1.0.4", FromConversion="autodesk.unit.unit:centimeters-1.0.1", ToConversion="autodesk.unit.unit:feet-1.0.1")
name = DynamoUnits.Unit.Name()  # unwired: unit
length = Curve.Length(curve=location.Line)
name_2 = DynamoUnits.Unit.Name(unit=length)
getCurrentProjectLengthUnit = AnalyticalAutomation.Utilities.UnitsUtilities.GetCurrentProjectLengthUnit()
code_block_7 = CodeBlock {  }
units = Units("Feet")
